# Dynamo graph CableTrayRoutes46.dyn (Dynamo 3.5.2.8914)

getExcelFiles = Custom[GetExcelFiles]()
code_block = CodeBlock { "C:\\Revit\\Excel\\RevitMacros02.xlsx"; "Routes"; 0; 1; }
integer_slider = IntegerSlider(33, range=0..100 step 1)
connection_points = Python(IN[0]=integer_slider)  # CPython3
# ---------- connection_points.python (255 lines) ----------
import clr
import math
clr.AddReference('RevitAPI')
clr.AddReference('RevitServices')

from Autodesk.Revit.DB import *
from RevitServices.Persistence import DocumentManager

fittingParams = ['Bend Radius','Tray Length','Tray Width',
                'Tray Height', 'Tray Height 1', 'Tray Height 2',
                'Length 1','Length 3','Tray Width 1','Tray Width 2','Tray Width 3']

extraParams = ['Level']

titles = ['Id', 'Mark', 'Comments', 'Service Type', 'TypeId', 'TypeName', 'FamilyName', 
          'Length', 'Width', 'Height',
          'Ref','N1','N2','N3','N4','P1','P2','P3','P4',
          'X1','Y1','Z1','X2','Y2','Z2','X3','Y3','Z3','X4','Y4','Z4', 'Angle'] + fittingParams + extraParams

C0 = titles.index('N1')
C1 = titles.index('X1')

tol = 30.0
f = 25.4*12
fd = 180/math.pi

cps = [titles]

def dim(val1):
    return round(val1*f,3)

def log(message):
    with open("C:\\revit\\logs\log01.txt", "a") as log_file:
        log_file.write(message + "\n")

def checkPoints(pt1,pt2,p1,p2):
    if ((cps[pt1][p1]) == '') or (cps[pt2][p2] == ''):
        return False
    #return (cps[pt1][p1] == cps[pt2][p2]) and (cps[pt1][p1+1] == cps[pt2][p2+1]) and (cps[pt1][p1+2] == cps[pt2][p2+2])
    return abs(cps[pt1][p1] - cps[pt2][p2]) < tol and abs(cps[pt1][p1+1] - cps[pt2][p2+1]) < tol and abs(cps[pt1][p1+2] - cps[pt2][p2+2]) < tol

def checkConnections():
    lCps = len(cps)
    for ptr1  in range(1, lCps-1):
        for ptr2 in range(ptr1 + 1,lCps):        
            for r in range(4):
                for s in range(4):
                    if checkPoints(ptr1, ptr2, C1 + (r*3), C1 + (s*3)):
                        cps[ptr1][C0 + r] = ptr2
                        cps[ptr2][C0 + s] = ptr1
 
# Function to get the coordinates of connection points
def get_tray_connectors(elem):
    connector_manager = elem.ConnectorManager
    typeData = get_cable_tray_type(elem)
    params =get_cable_tray_params(elem)
    paramData = [dim(params["Length"]),dim(params["Width"]),dim(params["Height"])]
    customData = [params["Mark"], params["Comments"], params["Service Type"]]
    extraData = [doc.GetElement(elem.LevelId).Name]
    
    connection_points = [elem.Id]
    connection_points.extend(customData)
    connection_points.extend(typeData)
    connection_points.extend(paramData)
    connection_points.extend(['']*9)
    connNum = 0
    for cn in connector_manager.Connectors:
        connection_points.extend([dim(cn.Origin.X),dim(cn.Origin.Y),dim(cn.Origin.Z)])
        connNum +=1
    
    if (connNum <4):
        connection_points.extend(['']*3*(4-connNum))

    connection_points.extend(['']*(len(fittingParams)+1))
    connection_points.extend(extraData)    
    
    return [connection_points]      

def get_fitting_connectors(elem):
    typeData = get_cable_tray_type(elem)
    params =get_cable_tray_params(elem)
    extraData = [doc.GetElement(elem.LevelId).Name]
    dist1 = 0
    dist2 = 0
    dist3 = 0
    orgs = []
    
    def shortConnectors(cn):
        tol = 1
        for c in cn:
            orgs.append(c.Origin)

        if (typeData[2].endswith('Horizontal Tee')):
            return getAligned(orgs)

        if (typeData[2].endswith('Horizontal Tee')):
            length1 = getDim('Length 1')
            getDist(orgs)
            if abs(dist1-length1) < tol:
                #log("0,1,2")
                return [orgs[0], orgs[1], orgs[2]]
            elif abs(dist2-length1) < tol:
                #log("0,2,1")
                return [orgs[0], orgs[2], orgs[1]]
            elif abs(dist3-length1) < tol:
                #log("1,2,0")
                return [orgs[1], orgs[2], orgs[0]]
        return orgs
        
    def getAligned(orgs):
        for i1, i2, i3 in [(0, 1, 2), (0, 2, 1), (1, 2, 0)]:
            if orgs[i1].X == orgs[i2].X:
                return [orgs[i1], orgs[i2], orgs[i3]] if orgs[i1].Y < orgs[i2].Y else [orgs[i2], orgs[i1], orgs[i3]]
            if orgs[i1].Y == orgs[i2].Y:
                return [orgs[i1], orgs[i2], orgs[i3]] if orgs[i1].X < orgs[i2].X else [orgs[i2], orgs[i1], orgs[i3]]
        return orgs        
    
    def getDim(parName):
        return round(float(params.get(parName,0)*f),1)

    def getAngle(parName):
        return round(float(params.get(parName,0)*fd),1)
    
    def getAngleRad(parName):
        return float(params.get(parName,0))

    def getLength():
        lVal = 0
        TypeVal = typeData[2]
        if TypeVal.endswith('Horizontal Bend'):
            lVal = (getDim('Bend Radius')+getDim('Tray Width')/2)*getAngleRad('Angle')
        elif TypeVal.endswith('Horizontal Cross'):
            #lVal = max(getDim('Length 1'),getDim('Length 3'))
            lVal = getDist(orgs)
        elif TypeVal.endswith('Horizontal Tee'):
            lVal = getDist(orgs)
            #lVal = max(getDim('Length 1'),getDim('Length 3'))
        elif TypeVal.endswith('Vertical Inside Bend'):
            lVal = (getDim('Bend Radius')+getDim('Tray Height')/2)*getAngleRad('Angle')
        elif TypeVal.endswith('Vertical Outside Bend'):
            lVal = (getDim('Bend Radius')+getDim('Tray Height')/2)*getAngleRad('Angle')
        elif TypeVal.endswith('Reducer'):
            lVal = getDim('Tray Length')
        else:
            lVal =0
        return round(lVal,3)

    def getFittingParams():
        fittingData = []
        for par in fittingParams:
            fittingData.append(getDim(par))
        return fittingData

    def getDist(orgs):
        dist1 = orgs[0].DistanceTo(orgs[1])*f
        dist2 = orgs[0].DistanceTo(orgs[2])*f
        dist3 = orgs[1].DistanceTo(orgs[2])*f
        distMax = max(dist1, dist2, dist3)
        return distMax
        
    connector_manager = elem.MEPModel.ConnectorManager
    if connector_manager is None:
        log(elem.Name)
        return [] 
    
    connNum = 0         
    orgs = shortConnectors(connector_manager.Connectors)
    paramData =[getLength(),'','']
    customData = [params["Mark"] , params["Comments"], params["Service Type"]]
    fittingData = [ getAngle("Angle")] + getFittingParams()
    connection_points = [elem.Id]
    connection_points.extend(customData)
    connection_points.extend(typeData)
    connection_points.extend(paramData)
    connection_points.extend(['']*9)
    
    if hasattr(elem, 'MEPModel') and elem.MEPModel:
        for org in orgs:
            connection_points.extend([dim(org.X),dim(org.Y),dim(org.Z)])
            connNum +=1
        if (connNum <4):
            connection_points.extend(['']*3*(4-connNum))  
           
    connection_points.extend(fittingData)
    connection_points.extend(extraData)
    return [connection_points]

def get_parameter_value(element, built_in_param):
    param = element.get_Parameter(built_in_param)
    if param:
        return param.AsString() or param.AsDouble() or param.AsInteger()
    return None

def get_cable_tray_params(cable_tray):
    params = {}
    excluded_params = {"Image", "Category", "Reference Level", "Phase Demolished", "Phase Created", "Family and Type", "Family", "Type", "Type Id", "Level"}
    for param in cable_tray.Parameters:
        param_name = param.Definition.Name
        #log("Entry:" + param_name)
        if param.StorageType == StorageType.String:
            param_value = param.AsString()
        elif param.StorageType == StorageType.Double:
            param_value = param.AsDouble()
        elif param.StorageType == StorageType.Integer:
            param_value = param.AsInteger()
        #elif param.StorageType == StorageType.ElementId:
        #    eid = param.AsElementId()
        #    if param_name not in excluded_params and eid != ElementId.InvalidElementId:
        #        param_value = eid.IntegerValue
        #    else:
        #        param_value = None
        else:
            param_value = None
        params[param_name] = param_value
    return params

def get_cable_tray_type(element):
    # Get the type ID of the element
    type_id = element.GetTypeId()
    # Get the element type using the type ID
    element_type = doc.GetElement(type_id)
    # Get the type name
    type_name = element_type.get_Parameter(BuiltInParameter.ALL_MODEL_TYPE_NAME).AsString()
    family_name = element_type.get_Parameter(BuiltInParameter.ALL_MODEL_FAMILY_NAME).AsString()

    return [type_id, type_name, family_name]

f = 25.4*12

# Get the current Revit document
doc = DocumentManager.Instance.CurrentDBDocument

# Collect all CableTray elements
cable_trays = FilteredElementCollector(doc).OfCategory(BuiltInCategory.OST_CableTray).WhereElementIsNotElementType().ToElements()
cable_tray_fittings = FilteredElementCollector(doc).OfCategory(BuiltInCategory.OST_CableTrayFitting).WhereElementIsNotElementType().ToElements()

for tray in cable_trays:
    connection_points = get_tray_connectors(tray)
    cps.extend(connection_points)
    #log(str(len(connection_points[0]))+"\n")


for tray in cable_tray_fittings:
    connection_points = get_fitting_connectors(tray)
    cps.extend(connection_points)
    #log(str(len(connection_points[0]))+"\n")

ref1 = 1
for cp1 in cps[1:]:
    cp1[C0-1] = ref1
    ref1 = ref1 + 1

checkConnections()

OUT = cps
# ----------------------------------------
exportToExcel = Data.ExportToExcel(filePath=getExcelFiles, sheetName=code_block.out1, startRow=code_block.out2, startColumn=code_block.out2, data=connection_points, overWrite=code_block.out3, writeAsString=code_block.out2)
