# Dynamo graph DrawTrays40.dyn (Dynamo 3.5.2.8914)
# packages: Universo_BIM 19.10.11

getExcelFiles = Custom[GetExcelFiles]()
code_block = CodeBlock { "C:\\Revit\\Excel\\RevitMacros02.xlsx"; "LineDataOut"; "LineDataIn"; 1; 2; 0; }
code_block_2 = CodeBlock()
# ---------- code_block_2.designscript (4 lines) ----------
[["Id","Mark","FamilyName","X1","Y1","Z1","X2","Y2","Z2"]];
["Tray Without Fittings"];
["Tray With Fittings"];
["Fittings"];
# ----------------------------------------
file_from_path = FileObject(path=getExcelFiles)
code_block_3 = CodeBlock { "C:\\Revit\\Excel\\RevitMacros02.xlsx"; "LineDataIn"; false; true; "C:\\revit\\excel"; "RevitMacros??"; }
importExcel = Data.ImportExcel(file=file_from_path, sheetName=code_block_3.out1, readAsStrings=code_block_3.out2, showExcel=code_block_3.out3)
filter_blank_rows = Python(IN[0]=importExcel)  # CPython3
# ---------- filter_blank_rows.python (16 lines) ----------
# Load the Python Standard and DesignScript Libraries
import sys
import clr
clr.AddReference('ProtoGeometry')
from Autodesk.DesignScript.Geometry import *

list1 = IN[0]
list2 = []
#Filter Blank items and drop first column
for item in list1:
    if item[1]:
        list2.append(item[1:])   
    else:    
        break

OUT = list2
# ----------------------------------------
get_lines = Python(IN[0]=filter_blank_rows)  # CPython3
# ---------- get_lines.python (31 lines) ----------
import sys
import clr

clr.AddReference('ProtoGeometry')
from Autodesk.DesignScript.Geometry import *

#clr.AddReference("RevitAPI")
#clr.AddReference("RevitAPIUI")
#from Autodesk.Revit.UI import TaskDialog

#Data = UnwrapElement(IN[0])
Data = IN[0]
pNum = len(Data)

pc = 7 #Colum for point data begin

P = [0.0]*pNum*2

#n=0
#TaskDialog.Show("Alert Title",str(Data[n+1][pc]) )

for n in range(pNum-1):
        P[2*n] = Point.ByCoordinates(Data[n+1][pc],Data[n+1][pc+1],Data[n+1][pc+2])
        P[2*n+1] = Point.ByCoordinates(Data[n+1][pc+3],Data[n+1][pc+4],Data[n+1][pc+5])

Lines = []

for n in range(pNum-1):
    Lines += [Line.ByStartPointEndPoint(P[2*n], P[2*n+1])]

OUT = Lines
# ----------------------------------------
code_block_4 = CodeBlock(Data4=filter_blank_rows)
# ---------- code_block_4.designscript (8 lines) ----------
Data5=List.Transpose(Data4);
List.RestOfItems(Data5[0]);
List.RestOfItems(Data5[1]);
List.RestOfItems(Data5[2]);
List.RestOfItems(Data5[3]);
List.RestOfItems(Data5[4]);
List.RestOfItems(Data5[5]);
List.RestOfItems(Data5[6]);
# ----------------------------------------
level_from_name = Python(IN[0]=code_block_4.out2)  # CPython3
# ---------- level_from_name.python (26 lines) ----------
import clr
clr.AddReference('RevitAPI')
clr.AddReference('RevitServices')

from Autodesk.Revit.DB import FilteredElementCollector, BuiltInCategory, ElementId
from RevitServices.Persistence import DocumentManager

def GetLevel(level_name):
        level_id = None
        level_el = None

        for level in levels:
                if level.Name == level_name:
                        level_el = level
                        break
        return level_el

# Get the current Revit document
doc = DocumentManager.Instance.CurrentDBDocument
levels = FilteredElementCollector(doc).OfCategory(BuiltInCategory.OST_Levels).WhereElementIsNotElementType().ToElements()

level_elems = []
level_names = IN[0]
for level_name in level_names:
        level_elems.append(GetLevel(level_name))
OUT = level_elems
# ----------------------------------------
cableTrayByLines = Python(IN[0]=get_lines, IN[1]=code_block_4.out1, IN[2]=level_from_name, IN[3]=code_block_4.out6, IN[4]=code_block_4.out7, IN[5]=code_block_4.out4, IN[6]=code_block_4.out5)  # CPython3
# ---------- cableTrayByLines.python (58 lines) ----------
import clr

clr.AddReference("RevitServices")
import RevitServices
from RevitServices.Persistence import DocumentManager
from RevitServices.Transactions import TransactionManager
doc = DocumentManager.Instance.CurrentDBDocument

clr.AddReference("RevitAPI")
import Autodesk
from Autodesk.Revit.DB import *

clr.AddReference("RevitNodes")
import Revit
clr.ImportExtensions(Revit.Elements)
clr.ImportExtensions(Revit.GeometryConversion)

def SetParam(name, value):
        parType = tray.LookupParameter(name)
        if parType:
                parType.Set(value)

toggle = ""

lines = IN[0]
FirstPoint = [x.StartPoint for x in lines]
SecondPoint = [x.EndPoint for x in lines]
cabletraytypesid = float(IN[1]) if isinstance(IN[1],str) else IN[1]
levels = UnwrapElement(IN[2])
width = IN[3]
height =IN[4]
mark =IN[5]
service =IN[6]

elements = []
trays =[]

TransactionManager.Instance.EnsureInTransaction(doc)

for i,x in enumerate(FirstPoint):
        tray = Autodesk.Revit.DB.Electrical.CableTray.Create(doc,ElementId(cabletraytypesid[i]),FirstPoint[i].ToXyz(),SecondPoint[i].ToXyz(),levels[i].Id)

        param = tray.get_Parameter(BuiltInParameter.RBS_CABLETRAY_WIDTH_PARAM)
        param.SetValueString(width[i])

        param2 = tray.get_Parameter(BuiltInParameter.RBS_CABLETRAY_HEIGHT_PARAM)
        param2.SetValueString(height[i])

        SetParam("Mark",mark[i])
        SetParam("Service Type", service[i])

        #trays.append(tray)
        elements.append(tray.ToDSType(False))

TransactionManager.Instance.TransactionTaskDone()


OUT = elements
# ----------------------------------------
code_block_5 = CodeBlock(Elem1=cableTrayByLines) { Elem1.Id; }
code_block_6 = CodeBlock { "Mark"; }
getparam_string = Python(IN[0]=cableTrayByLines, IN[1]=code_block_6)  # CPython3
# ---------- getparam_string.python (24 lines) ----------
import clr
clr.AddReference('RevitAPI')
clr.AddReference('RevitServices')

from Autodesk.Revit.DB import *
from RevitServices.Persistence import DocumentManager

# Function to get the coordinates of connection points

def getParam(tray):
        param = tray.LookupParameter(IN[1])
        return(param.AsString())

f = 25.4*12

trays = IN[0]

params = []

for tray1 in trays:
        tray = UnwrapElement(tray1)
        params.append(getParam(tray))

OUT = params
# ----------------------------------------
type = Elements.Element.Type(element=cableTrayByLines)
code_block_7 = CodeBlock { "Family Name"; }
getparam_string_2 = Python(IN[0]=type, IN[1]=code_block_7)  # CPython3
# ---------- getparam_string_2.python (34 lines) ----------
import clr
clr.AddReference('RevitAPI')
clr.AddReference('RevitServices')

#from Autodesk.Revit.DB import *
from RevitServices.Persistence import DocumentManager

# Access the current Revit document
doc = DocumentManager.Instance.CurrentDBDocument

# Inputs from Dynamo
elems = IN[0]  # List of Revit elements
paramName = IN[1]  # Parameter name to search for

# Initialize a list to store parameter values
params = []

# Iterate over each element
for elem in elems:
        # Get all parameters of the element
        parameters = elem.Parameters
        param_value = None  # Initialize parameter value as None

        # Iterate through parameters to find the one matching the paramName
        for param in parameters:
                if param.Name == paramName:  # Check if the parameter name matches
                        param_value = param.Value
                        break  # Exit the loop once the parameter is found

        # Append the value (or 'Not Found') to the results list
        params.append(param_value if param_value is not None else "Not Found")

# Output the collected parameter values
OUT = params
# ----------------------------------------
locationCurve = Elements.Element.LocationCurve(element=cableTrayByLines)
code_block_8 = CodeBlock(Id=code_block_5, Mark=getparam_string, FamilyName=getparam_string_2, D=locationCurve) { [Id,Mark,FamilyName,D.StartPoint.X,D.StartPoint.Y,D.StartPoint.Z, D.EndPoint.X,D.EndPoint.Y,D.EndPoint.Z]; }
transpose = List.Transpose(lists=code_block_8)
cabletray_fitting = Python(IN[0]=cableTrayByLines, IN[1]=code_block_4.out3, IN[2]=code_block_8)  # CPython3
# ---------- cabletray_fitting.python (93 lines) ----------
import clr
clr.AddReference('RevitAPI')
clr.AddReference("RevitServices")
import RevitServices
from RevitServices.Persistence import DocumentManager
from RevitServices.Transactions import TransactionManager
doc = DocumentManager.Instance.CurrentDBDocument

from Autodesk.Revit.DB import *

clr.AddReference("RevitNodes")
import Revit

clr.ImportExtensions(Revit.Elements)
clr.ImportExtensions(Revit.GeometryConversion)


def createText(text):
        text_location = XYZ(0, 0, 0)
        active_view = doc.ActiveView
        text_note_types = FilteredElementCollector(doc).OfClass(TextNoteType).ToElements()
        text_type = text_note_types[0]
        text_note = TextNote.Create(doc, active_view.Id, text_location, text, text_type.Id)
        return(text_note.Id)

def log(text):
        with open("C:\\Revit\\Dynamos\\log.txt", "a") as file:
                file.write(text+"\n")

def getMark(tray):
        mark_param = tray.LookupParameter("Mark")
        return(mark_param.AsString())

def setMark(tray, value1):
        mark_param = tray.LookupParameter("Mark")
        mark_param.Set(value1)

def setFittingMark(tray1,tray2,fitting):
        mark1 = getMark(tray1)
        mark2 = getMark(tray2)
        setMark(fitting,mark1+"-"+mark2)

def closest_connectors(pipe1, pipe2):
        conn1 = pipe1.ConnectorManager.Connectors
        conn2 = pipe2.ConnectorManager.Connectors

        dist = 100000000
        connset = None
        for c in conn1:
                for d in conn2:
                        conndist = c.Origin.DistanceTo(d.Origin)
                        if conndist < dist:
                                dist = conndist
                                connset = [c,d]
        return connset

def check_dir(conn1,conn2):
        if conn1.CoordinateSystem.BasisZ.ToString() == conn2.CoordinateSystem.BasisZ.ToString() or conn1.CoordinateSystem.BasisZ.ToString() == (conn2.CoordinateSystem.BasisZ*-1).ToString():
                return True
        else:
                return False

def drawFitting(pipe1,pipe2):

        TransactionManager.Instance.EnsureInTransaction(doc)
        connectors = closest_connectors(pipe1,pipe2)

        try:
                if check_dir(connectors[0],connectors[1]):
                        textId = 100
                        #fitting = doc.Create.NewUnionFitting(connectors[0],connectors[1])
                        fitting = doc.Create.NewTransitionFitting(connectors[0],connectors[1])
                else:
                        fitting = doc.Create.NewElbowFitting(connectors[0],connectors[1])
        except:
                return

        if fitting is not None:
                setFittingMark(pipe1,pipe2,fitting)
                fittings.append(fitting.ToDSType(False))

        TransactionManager.Instance.TransactionTaskDone()


Data = IN[0]
Selection = IN[1]
fittings = []

for n in range(len(Data)-1):
        if Selection[n]:
                drawFitting(UnwrapElement(Data[n]), UnwrapElement(Data[n+1]))

OUT = fittings
# ----------------------------------------
tray_params = Python(IN[0]=cabletray_fitting)  # CPython3
# ---------- tray_params.python (39 lines) ----------
import clr
clr.AddReference('RevitAPI')
clr.AddReference('RevitServices')

from Autodesk.Revit.DB import *
from RevitServices.Persistence import DocumentManager

# Function to get the coordinates of connection points

def get_cable_tray_params(cable_tray):
        params = {}
        for param in cable_tray.Parameters:
                param_name = param.Definition.Name
                if param.StorageType == StorageType.String:
                        param_value = param.AsString()
                elif param.StorageType == StorageType.Double:
                        param_value = param.AsDouble()
                elif param.StorageType == StorageType.Integer:
                        param_value = param.AsInteger()
                elif param.StorageType == StorageType.ElementId:
                        param_value = param.AsElementId().IntegerValue
                else:
                        param_value = None
                params[param_name] = param_value
        return params

f = 25.4*12

trays = IN[0]

all_params = []
#all_params = [['Id', 'Mark','Service Type', 'TypeId', 'TypeName', 'FamilyName', 'Length', 'Width', 'Height','X1','Y1','Z1','X2','Y2','Z2','X3','Y3','Z3','X4','Y4','Z4']]

for tray in trays:
        params = get_cable_tray_params(UnwrapElement(tray))
        param = params['Mark']
        all_params.extend([param])

OUT = all_params
# ----------------------------------------
type_2 = Elements.Element.Type(element=cabletray_fitting)
code_block_9 = CodeBlock { "Family Name"; }
getparam_string_3 = Python(IN[0]=type_2, IN[1]=code_block_9)  # CPython3; same code as getparam_string_2
code_block_10 = CodeBlock(E=cabletray_fitting, Mark=tray_params, FamilyName=getparam_string_3) { [E.Id,Mark,FamilyName,E.Location.X,E.Location.Y,E.Location.Z]; }
transpose_2 = List.Transpose(lists=code_block_10)
sync = CodeBlock(A1=transpose, A2=transpose_2) { A1; A2; }
sync_2 = CodeBlock(B1=code_block_2.out2, B2=transpose_2) { B1; B2; }
getElementFromId = Python(IN[0]=code_block_5, IN[1]=cabletray_fitting)  # CPython3
# ---------- getElementFromId.python (27 lines) ----------
import clr

# Import RevitAPI classes
clr.AddReference('RevitAPI')
clr.AddReference('RevitServices')
from Autodesk.Revit.DB import ElementId
from RevitServices.Persistence import DocumentManager

# Inputs
element_ids = IN[0]  # List of element IDs
doc = DocumentManager.Instance.CurrentDBDocument

# Initialize an empty list to store elements
elements = []

# Iterate through the list of IDs
for eid in element_ids:
    # Convert the input ID to an ElementId object
    id = ElementId(eid)
    # Get the element
    element = doc.GetElement(id)
    # Add the element to the list
    if element:
        elements.append(element)

# Output the list of elements
OUT = elements
# ----------------------------------------
locationCurve_2 = Elements.Element.LocationCurve(element=getElementFromId)
code_block_11 = CodeBlock(Id=code_block_5, Mark=getparam_string, FamilyName=getparam_string_2, D=locationCurve_2) { [Id,Mark,FamilyName,D.StartPoint.X,D.StartPoint.Y,D.StartPoint.Z, D.EndPoint.X,D.EndPoint.Y,D.EndPoint.Z]; }
transpose_3 = List.Transpose(lists=code_block_11)
join = List.Join(list0=code_block_2.out0, list1=code_block_2.out1, list2=sync.A1, list3=sync_2.B1, list4=transpose_3, list5=code_block_2.out3, list6=transpose_2)
exportToExcel = Data.ExportToExcel(filePath=getExcelFiles, sheetName=code_block.out1, startRow=code_block.out3, startColumn=code_block.out3, data=join, overWrite=code_block.out3)
code_block_12 = CodeBlock(Data=code_block_8) { Data[0]; }
exportToExcel_2 = Data.ExportToExcel(filePath=getExcelFiles, sheetName=code_block.out2, startRow=code_block.out3, startColumn=code_block.out5, data=code_block_12, overWrite=code_block.out5)
