# Dynamo graph CableTrayRoutes09.dyn (Dynamo 2.3.0.5885)

code_block = CodeBlock { "C:\\Revit\\Excel\\RevitMacros02.xlsx"; "Data"; 0; 1; }
integer_slider = IntegerSlider(41, range=0..100 step 1)
connection_points = Python(IN[0]=integer_slider)
# ---------- connection_points.python (100 lines) ----------
import clr
clr.AddReference('RevitAPI')
clr.AddReference('RevitServices')

from Autodesk.Revit.DB import *
from RevitServices.Persistence import DocumentManager

# Function to get the coordinates of connection points
def get_tray_connectors(elem):
	connector_manager = elem.ConnectorManager
	typeData = get_cable_tray_type(elem)
	params =get_cable_tray_params(elem)
	paramData = [params["Length"]*f,params["Width"]*f,params["Height"]*f]
	customData = [params["Mark"] ,params["Service Type"]]

	connection_points = [elem.Id]
	connection_points.extend(customData)
	connection_points.extend(typeData)
	connection_points.extend(paramData)
		
	for cn in connector_manager.Connectors:
		connection_points.extend([cn.Origin.X*f,cn.Origin.Y*f,cn.Origin.Z*f])

	return [connection_points]	

def get_fitting_connectors(elem):
	typeData = get_cable_tray_type(elem)
	params =get_cable_tray_params(elem)
	#paramData = [params["Length"]*f,params["Width"]*f,params["Height"]*f]
	paramData =['','','']
	customData = [params["Mark"] ,params["Service Type"]]

	
	connection_points = [elem.Id]
	connection_points.extend(customData)
	connection_points.extend(typeData)
	connection_points.extend(paramData)

	if hasattr(elem, 'MEPModel') and elem.MEPModel:
		connector_manager = elem.MEPModel.ConnectorManager
		for cn in connector_manager.Connectors:
			connection_points.extend([cn.Origin.X*f,cn.Origin.Y*f,cn.Origin.Z*f])
	return [connection_points]

def get_parameter_value(element, built_in_param):
	param = element.get_Parameter(built_in_param)
	if param:
		return param.AsString() or param.AsDouble() or param.AsInteger()
	return None

def get_cable_tray_params(cable_tray):
	params = {}
	for param in cable_tray.Parameters:
		param_name = param.Definition.Name
		if param.StorageType == StorageType.String:
			param_value = param.AsString()
		elif param.StorageType == StorageType.Double:
			param_value = param.AsDouble()
		elif param.StorageType == StorageType.Integer:
			param_value = param.AsInteger()
		elif param.StorageType == StorageType.ElementId:
			param_value = param.AsElementId().IntegerValue
		else:
			param_value = None
		params[param_name] = param_value
	return params

def get_cable_tray_type(element):
	# Get the type ID of the element
	type_id = element.GetTypeId()
	# Get the element type using the type ID
	element_type = doc.GetElement(type_id)
	# Get the type name
	type_name = element_type.get_Parameter(BuiltInParameter.ALL_MODEL_TYPE_NAME).AsString()
	family_name = element_type.get_Parameter(BuiltInParameter.ALL_MODEL_FAMILY_NAME).AsString()

	return  [type_id, type_name, family_name]

f = 25.4*12

# Get the current Revit document
doc = DocumentManager.Instance.CurrentDBDocument

# Collect all CableTray elements
cable_trays = FilteredElementCollector(doc).OfCategory(BuiltInCategory.OST_CableTray).WhereElementIsNotElementType().ToElements()
cable_tray_fittings = FilteredElementCollector(doc).OfCategory(BuiltInCategory.OST_CableTrayFitting).WhereElementIsNotElementType().ToElements()

all_connection_points = [['Id', 'Mark','Service Type', 'TypeId', 'TypeName', 'FamilyName', 'Length', 'Width', 'Height','X1','Y1','Z1','X2','Y2','Z2','X3','Y3','Z3','X4','Y4','Z4']]

for tray in cable_trays:
	connection_points = get_tray_connectors(tray)
	all_connection_points.extend(connection_points)


for tray in cable_tray_fittings:
	connection_points = get_fitting_connectors(tray)
	all_connection_points.extend(connection_points)


OUT = all_connection_points
# ----------------------------------------
watch = Watch(connection_points)
exportExcel = Data.ExportExcel(filePath=code_block.out0, sheetName=code_block.out1, startRow=code_block.out2, startCol=code_block.out3, data=watch, overWrite=code_block.out3)
cableTrayParams = Python()  # unwired: IN[0]
# ---------- cableTrayParams.python (39 lines) ----------
import clr
clr.AddReference('RevitAPI')
clr.AddReference('RevitServices')

from Autodesk.Revit.DB import *
from RevitServices.Persistence import DocumentManager

# Get the current Revit document
doc = DocumentManager.Instance.CurrentDBDocument

# Collect all CableTray elements
cable_trays = FilteredElementCollector(doc).OfCategory(BuiltInCategory.OST_CableTrayFitting).WhereElementIsNotElementType().ToElements()

# Function to get parameters of a cable tray
def get_cable_tray_params(cable_tray):
	params = {}
	for param in cable_tray.Parameters:
		param_name = param.Definition.Name
		if param.StorageType == StorageType.String:
			param_value = param.AsString()
		elif param.StorageType == StorageType.Double:
			param_value = param.AsDouble()
		elif param.StorageType == StorageType.Integer:
			param_value = param.AsInteger()
		elif param.StorageType == StorageType.ElementId:
			param_value = param.AsElementId().IntegerValue
		else:
			param_value = None
		params[param_name] = param_value
	return params

# Get parameters for all cable trays
all_cable_tray_params = []
for cable_tray in cable_trays:
	tray_params = get_cable_tray_params(cable_tray)
	all_cable_tray_params.append(tray_params)

# Output the list of parameters for all cable trays
OUT = all_cable_tray_params
# ----------------------------------------
watch_2 = Watch(cableTrayParams)
code_block_2 = CodeBlock(Data6=watch_2) { Data6["Longitud de bandeja"]*25.4*12; }
watch_3 = Watch(code_block_2)
trayTypes = Python()  # frozen; unwired: IN[0]
# ---------- trayTypes.python (16 lines) ----------
import clr
clr.AddReference('RevitAPI')
clr.AddReference('RevitServices')
from RevitServices.Persistence import DocumentManager
from Autodesk.Revit.DB import FilteredElementCollector, BuiltInCategory, ElementType

# Get the active document
doc = DocumentManager.Instance.CurrentDBDocument

tray_types = FilteredElementCollector(doc).OfClass(ElementType).OfCategory(BuiltInCategory.OST_CableTray).ToElements()

cable_trays = FilteredElementCollector(doc).OfCategory(BuiltInCategory.OST_CableTray).WhereElementIsNotElementType().ToElements()


# Output the cable tray types
OUT = cable_trays
# ----------------------------------------
connection_points_2 = Python()  # frozen; unwired: IN[0]
# ---------- connection_points_2.python (24 lines) ----------
import clr
clr.AddReference('RevitAPI')
clr.AddReference('RevitServices')

from Autodesk.Revit.DB import *
from RevitServices.Persistence import DocumentManager

# Get the current Revit document
doc = DocumentManager.Instance.CurrentDBDocument

# Collect all CableTray elements
cable_trays = FilteredElementCollector(doc).OfCategory(BuiltInCategory.OST_CableTray).WhereElementIsNotElementType().ToElements()
#cable_tray_fittings = FilteredElementCollector(doc).OfCategory(BuiltInCategory.OST_CableTrayFitting).WhereElementIsNotElementType().ToElements()
#tray_types = FilteredElementCollector(doc).OfClass(ElementType).OfCategory(BuiltInCategory.OST_CableTray).ToElements()

itemCol = cable_trays

result = []

for item in itemCol:
	for par in item.Parameters:
		result.append(str(par))

OUT = result
# ----------------------------------------
