# Dynamo graph DisplayId04.dyn (Dynamo 2.3.0.5885)

integer_slider = IntegerSlider(63, range=0..100 step 1)
python_script = Python(IN[0]=integer_slider)
# ---------- python_script.python (48 lines) ----------
import clr
clr.AddReference('RevitAPI')
clr.AddReference('RevitServices')

from Autodesk.Revit.DB import ElementId, XYZ, TextNote, TextNoteType, FilteredElementCollector, BuiltInCategory, LocationPoint, LocationCurve
from RevitServices.Persistence import DocumentManager
from RevitServices.Transactions import TransactionManager

# Get the current document and UIDocument
doc = DocumentManager.Instance.CurrentDBDocument
uiapp = DocumentManager.Instance.CurrentUIApplication
uidoc = uiapp.ActiveUIDocument

# Collect CableTray elements
cable_trays = FilteredElementCollector(doc).OfCategory(BuiltInCategory.OST_CableTray).WhereElementIsNotElementType().ToElements()

# Collect CableTrayFitting elements
cable_tray_fittings = FilteredElementCollector(doc).OfCategory(BuiltInCategory.OST_CableTrayFitting).WhereElementIsNotElementType().ToElements()

# Combine the collections
elements = list(cable_trays) + list(cable_tray_fittings)

for element in elements:

	element_id = element.Id
	# Define the position for the text note (near the element)
	element_location = None
	if isinstance(element.Location, LocationPoint):
		element_location = element.Location.Point
	elif isinstance(element.Location, LocationCurve):
		#element_location = element.Location.Curve.GetEndPoint(0)  # Get the start point of the curve
		element_location = element.Location.Curve.Evaluate(0.5, True)

	# Ensure element_location is set
	if element_location:
		text_note_position = element_location # Adjust the offset as needed

		# Get a TextNoteType (choose one from the document)
		text_note_type = FilteredElementCollector(doc).OfClass(TextNoteType).FirstElement()

		# Start a transaction to create the text note
		TransactionManager.Instance.EnsureInTransaction(doc)

		# Create the text note
		text_note = TextNote.Create(doc, doc.ActiveView.Id, text_note_position, str(element_id.IntegerValue), text_note_type.Id)

		# Commit the transaction
		TransactionManager.Instance.TransactionTaskDone()
# ----------------------------------------
