# Dynamo graph DisplayId05.dyn (Dynamo 2.3.0.5885)

integer_slider = IntegerSlider(51, range=0..100 step 1)
python_script = Python(IN[0]=integer_slider)
# ---------- python_script.python (68 lines) ----------
import clr
clr.AddReference('RevitAPI')
clr.AddReference('RevitServices')

from Autodesk.Revit.DB import ElementId, XYZ, TextNote, TextNoteType, FilteredElementCollector, BuiltInCategory, LocationPoint, LocationCurve
from RevitServices.Persistence import DocumentManager
from RevitServices.Transactions import TransactionManager

# Get the current document and UIDocument
doc = DocumentManager.Instance.CurrentDBDocument
uiapp = DocumentManager.Instance.CurrentUIApplication
uidoc = uiapp.ActiveUIDocument

def GetParam(element, name):
	par_val = ''
	parType = element.LookupParameter(name)	
	if parType:	
		par_val = parType.AsString()
	return par_val
# Collect CableTray elements
cable_trays = FilteredElementCollector(doc).OfCategory(BuiltInCategory.OST_CableTray).WhereElementIsNotElementType().ToElements()

# Collect CableTrayFitting elements
cable_tray_fittings = FilteredElementCollector(doc).OfCategory(BuiltInCategory.OST_CableTrayFitting).WhereElementIsNotElementType().ToElements()

# Combine the collections

for element in list(cable_trays):

	element_mark = GetParam(element,'Mark')
	element_id = element.Id
	element_location = None
	if isinstance(element.Location, LocationPoint):
		element_location = element.Location.Point
	elif isinstance(element.Location, LocationCurve):
		#element_location = element.Location.Curve.GetEndPoint(0)  # Get the start point of the curve
		element_location = element.Location.Curve.Evaluate(0.5, True)

	# Ensure element_location is set
	if element_location:
		text_note_position = element_location # Adjust the offset as needed
		text_note_type = FilteredElementCollector(doc).OfClass(TextNoteType).FirstElement()
		TransactionManager.Instance.EnsureInTransaction(doc)
		text = str(element.Id)+':' + str(element_mark)
		text_note = TextNote.Create(doc, doc.ActiveView.Id, text_note_position, text, text_note_type.Id)
		TransactionManager.Instance.TransactionTaskDone()


for element in list(cable_tray_fittings):

	element_mark = GetParam(element,'Mark')
	element_id = element.Id
	element_location = None
	if isinstance(element.Location, LocationPoint):
		element_location = element.Location.Point
	elif isinstance(element.Location, LocationCurve):
		#element_location = element.Location.Curve.GetEndPoint(0)  # Get the start point of the curve
		element_location = element.Location.Curve.Evaluate(0.5, True)

	# Ensure element_location is set
	if element_location:
		text_note_position = element_location # Adjust the offset as needed
		text_note_type = FilteredElementCollector(doc).OfClass(TextNoteType).FirstElement()
		TransactionManager.Instance.EnsureInTransaction(doc)
		
		text = str(element.Id)+':' + str(element_mark)
		text_note = TextNote.Create(doc, doc.ActiveView.Id, text_note_position, text, text_note_type.Id)
		TransactionManager.Instance.TransactionTaskDone()
# ----------------------------------------
