# Dynamo graph DisplayId06.dyn (Dynamo 3.3.0.6316)

integer_slider = IntegerSlider(35, range=0..100 step 1)
mark = CodeBlock { ""; }
text_size = CodeBlock { 0.26; }
python_script = Python(IN[0]=integer_slider, IN[1]=mark, IN[2]=text_size)  # IronPython2
# ---------- python_script.python (75 lines) ----------
import clr
clr.AddReference('RevitAPI')
clr.AddReference('RevitServices')

from Autodesk.Revit.DB import ElementId, XYZ, TextNote, TextNoteType, FilteredElementCollector, BuiltInCategory, LocationPoint, LocationCurve
from RevitServices.Persistence import DocumentManager
from RevitServices.Transactions import TransactionManager
from Autodesk.Revit.DB import Color

# Get the current document and UIDocument
doc = DocumentManager.Instance.CurrentDBDocument
uiapp = DocumentManager.Instance.CurrentUIApplication
uidoc = uiapp.ActiveUIDocument

markStr = IN[1]
textSize = IN[2]/25.4/12

def GetParam(element, name):
    par_val = ''
    parType = element.LookupParameter(name)    
    if parType:    
        par_val = parType.AsString()
    return par_val
# Collect CableTray elements
cable_trays = FilteredElementCollector(doc).OfCategory(BuiltInCategory.OST_CableTray).WhereElementIsNotElementType().ToElements()

# Collect CableTrayFitting elements
cable_tray_fittings = FilteredElementCollector(doc).OfCategory(BuiltInCategory.OST_CableTrayFitting).WhereElementIsNotElementType().ToElements()

# Combine the collections

for element in list(cable_trays):

    element_mark = GetParam(element,markStr)
    element_id = element.Id
    element_location = None
    if isinstance(element.Location, LocationPoint):
        element_location = element.Location.Point
    elif isinstance(element.Location, LocationCurve):
        #element_location = element.Location.Curve.GetEndPoint(0)  # Get the start point of the curve
        element_location = element.Location.Curve.Evaluate(0.5, True)

    # Ensure element_location is set
    if element_location:
        text_note_position = element_location # Adjust the offset as needed
        text_note_type = FilteredElementCollector(doc).OfClass(TextNoteType).FirstElement()
        TransactionManager.Instance.EnsureInTransaction(doc)
        text = str(element.Id)+':' + str(element_mark)
        text_note = TextNote.Create(doc, doc.ActiveView.Id, text_note_position, text, text_note_type.Id)
        text_note_type = text_note.TextNoteType
        text_note_type.LookupParameter("Text Size").Set(textSize)
        text_note_type.LookupParameter("Color").Set(0x0000ff)
        
        TransactionManager.Instance.TransactionTaskDone()


for element in list(cable_tray_fittings):
    element_mark = GetParam(element,markStr)
    element_id = element.Id
    element_location = None
    if isinstance(element.Location, LocationPoint):
        element_location = element.Location.Point
    elif isinstance(element.Location, LocationCurve):
        #element_location = element.Location.Curve.GetEndPoint(0)  # Get the start point of the curve
        element_location = element.Location.Curve.Evaluate(0.5, True)

    # Ensure element_location is set
    if element_location:
        text_note_position = element_location # Adjust the offset as needed
        text_note_type = FilteredElementCollector(doc).OfClass(TextNoteType).FirstElement()
        TransactionManager.Instance.EnsureInTransaction(doc)
        
        text = str(element.Id)+':' + str(element_mark)
        text_note = TextNote.Create(doc, doc.ActiveView.Id, text_note_position, text, text_note_type.Id)
        TransactionManager.Instance.TransactionTaskDone()
# ----------------------------------------
