# Dynamo graph DrawTrays16.dyn (Dynamo 2.3.0.5885)
# packages: MEPover 2020.6.2, Universo_BIM 19.10.11

code_block = CodeBlock { "C:\\Revit\\Excel\\RevitMacros02.xlsx"; "LineDataIn"; false; true; }
file_from_path = FileObject(path=code_block.out0)
importExcel = Data.ImportExcel(file=file_from_path, sheetName=code_block.out1, readAsStrings=code_block.out2, showExcel=code_block.out3)
get_lines = Python(IN[0]=importExcel)
# ---------- get_lines.python (24 lines) ----------
import sys
import clr

clr.AddReference('ProtoGeometry')
from Autodesk.DesignScript.Geometry import *


Data = IN[0]
pNum = len(Data)

P = [0]*pNum*2

for n in range(pNum-1):
	P[2*n] = Point.ByCoordinates(Data[n+1][5],Data[n+1][6],Data[n+1][7])
	P[2*n+1] = Point.ByCoordinates(Data[n+1][8],Data[n+1][9],Data[n+1][10])

Lines = []

for n in range(pNum-1):
    Lines += [Line.ByStartPointEndPoint(P[2*n], P[2*n+1])]

OUT = Lines

  
# ----------------------------------------
code_block_2 = CodeBlock(Data4=importExcel)
# ---------- code_block_2.designscript (6 lines) ----------
Data5=List.Transpose(Data4);
Data5[0][1];
Data5[1][1];
List.RestOfItems(Data5[2]);
List.RestOfItems(Data5[3]);
List.RestOfItems(Data5[4]);
# ----------------------------------------
element_by_id = Python(IN[0]=code_block_2.out1)
# ---------- element_by_id.python (10 lines) ----------
import clr
clr.AddReference('RevitAPI')
clr.AddReference('RevitServices')

from Autodesk.Revit.DB import ElementId
from RevitServices.Persistence import DocumentManager

# Get the current document
doc = DocumentManager.Instance.CurrentDBDocument
OUT = doc.GetElement(ElementId(IN[0]))
# ----------------------------------------
level_from_name = Python(IN[0]=code_block_2.out2)
# ---------- level_from_name.python (27 lines) ----------
import clr
clr.AddReference('RevitAPI')
clr.AddReference('RevitServices')

from Autodesk.Revit.DB import FilteredElementCollector, BuiltInCategory, ElementId
from RevitServices.Persistence import DocumentManager

# Get the current Revit document
doc = DocumentManager.Instance.CurrentDBDocument

# Input: level_name (type: str)
level_name = IN[0]  # Example: "Level 1"

# Get all levels in the document
levels = FilteredElementCollector(doc).OfCategory(BuiltInCategory.OST_Levels).WhereElementIsNotElementType().ToElements()

# Find the level with the specified name and get its ID
level_id = None
level_el = None

for level in levels:
    if level.Name == level_name:
        level_id = level.Id
        level_el = level
        break

OUT = level_el
# ----------------------------------------
watch = Watch(level_from_name)
byLines3 = Custom[CableTray.ByLines3](Lines=get_lines, CableTrayType=element_by_id, level=watch, Width=code_block_2.out4, Height=code_block_2.out5)  # package MEPover; Creates CableTray by Lines, CableTrayType, Level, Width and Height
code_block_3 = CodeBlock(DataVal=byLines3) { DataVal.Parameters; }
watch_2 = Watch(code_block_3)
code_block_4 = CodeBlock { "C:\\Revit\\Excel\\RevitMacros02.xlsx"; "LineDataOut"; 1; 1; 1; }
code_block_5 = CodeBlock(Elem1=byLines3) { Elem1.Id; }
locationCurve = Elements.Element.LocationCurve(element=byLines3)
code_block_6 = CodeBlock(Id=code_block_5, D=locationCurve) { [Id, D.StartPoint.X,D.StartPoint.Y,D.StartPoint.Z, D.EndPoint.X,D.EndPoint.Y,D.EndPoint.Z]; }
transpose = List.Transpose(lists=code_block_6)
cabletray_fitting = Python(IN[0]=byLines3, IN[1]=code_block_2.out3, IN[2]=code_block_6)
# ---------- cabletray_fitting.python (67 lines) ----------
import clr

clr.AddReference("RevitServices")
import RevitServices
from RevitServices.Persistence import DocumentManager
from RevitServices.Transactions import TransactionManager
doc = DocumentManager.Instance.CurrentDBDocument

clr.AddReference("RevitAPI")
from Autodesk.Revit.DB import *

clr.AddReference("RevitNodes")
import Revit
clr.ImportExtensions(Revit.Elements)
clr.ImportExtensions(Revit.GeometryConversion)

def closest_connectors(pipe1, pipe2):
	conn1 = pipe1.ConnectorManager.Connectors
	conn2 = pipe2.ConnectorManager.Connectors

	dist = 100000000
	connset = None
	for c in conn1:
		for d in conn2:
			conndist = c.Origin.DistanceTo(d.Origin)
			if conndist < dist:
				dist = conndist
				connset = [c,d]
	return connset

def check_dir(conn1,conn2):
	if conn1.CoordinateSystem.BasisZ.ToString() == conn2.CoordinateSystem.BasisZ.ToString() or conn1.CoordinateSystem.BasisZ.ToString() == (conn2.CoordinateSystem.BasisZ*-1).ToString():
		return True
	else:
		return False

def drawFitting(pipe1,pipe2):

	TransactionManager.Instance.EnsureInTransaction(doc)

	for p1,p2 in zip(pipe1,pipe2):
		connectors = closest_connectors(p1,p2)
		
	try:
		if check_dir(connectors[0],connectors[1]):
			fitting = doc.Create.NewUnionFitting(connectors[0],connectors[1])
		else:
			fitting = doc.Create.NewElbowFitting(connectors[0],connectors[1])
	except:
		print("Fitting Error")	
			
	else:
		if fitting is not None:
			fittings.append(fitting.ToDSType(False))
		
	TransactionManager.Instance.TransactionTaskDone()


Data = IN[0]
Selection = IN[1]
fittings = []

for n in range(len(Data)-1):
	if Selection[n]:
		drawFitting([UnwrapElement(Data[n])], [UnwrapElement(Data[n+1])])

OUT = fittings
# ----------------------------------------
watch_3 = Watch(cabletray_fitting)
code_block_7 = CodeBlock(E=watch_3) { [E.Id, E.Location.X,E.Location.Y,E.Location.Z]; }
watch_4 = Watch(code_block_7)
transpose_2 = List.Transpose(lists=watch_4)
join = List.Join(list0=transpose, list1=transpose_2)
watch_5 = Watch(join)
exportExcel = Data.ExportExcel(filePath=code_block_4.out0, sheetName=code_block_4.out1, startRow=code_block_4.out2, startCol=code_block_4.out3, data=watch_5, overWrite=code_block_4.out4)
code_block_8 = CodeBlock(SEQ01=exportExcel) { [["ID","X1","Y1","Z1","X2","Y2","Z2"]]; 0; SEQ01; }
exportExcel_2 = Data.ExportExcel(filePath=code_block_4.out0, sheetName=code_block_4.out1, startRow=code_block_8.out1, startCol=code_block_4.out3, data=code_block_8.out0, overWrite=code_block_8.out1)
python_script = Python()  # unwired: IN[0]
# ---------- python_script.python (19 lines) ----------
import clr
clr.AddReference('RevitAPI')
clr.AddReference('RevitServices')
from RevitServices.Persistence import DocumentManager
from Autodesk.Revit.DB import FilteredElementCollector, BuiltInCategory, ElementType

# Get the active document
doc = DocumentManager.Instance.CurrentDBDocument

# Collect all cable tray types in the document
#collector = FilteredElementCollector(doc).OfClass(CableTrayType)

# Extract the cable tray types
#tray_types = [tray_type for tray_type in collector]

tray_types = FilteredElementCollector(doc).OfClass(ElementType).OfCategory(BuiltInCategory.OST_CableTray).ToElements()

# Output the cable tray types
OUT = tray_types
# ----------------------------------------
code_block_9 = CodeBlock(Data1=python_script) { Data1.Name; }
watch_6 = Watch(code_block_9)
