# Dynamo graph DrawTrays21.dyn (Dynamo 2.3.0.5885)
# packages: Universo_BIM 19.10.11

code_block = CodeBlock { "C:\\Revit\\Excel\\RevitMacros02.xlsx"; "LineDataOut"; 1; 1; 1; }
code_block_2 = CodeBlock { "C:\\Revit\\Excel\\RevitMacros02.xlsx"; "LineDataIn"; false; true; }
file_from_path = FileObject(path=code_block_2.out0)
importExcel = Data.ImportExcel(file=file_from_path, sheetName=code_block_2.out1, readAsStrings=code_block_2.out2, showExcel=code_block_2.out3)
get_lines = Python(IN[0]=importExcel)
# ---------- get_lines.python (25 lines) ----------
import sys
import clr

clr.AddReference('ProtoGeometry')
from Autodesk.DesignScript.Geometry import *

Data = IN[0]
pNum = len(Data)

pc = 7 #Colum for point data begin

P = [0]*pNum*2

for n in range(pNum-1):
	P[2*n] = Point.ByCoordinates(Data[n+1][pc],Data[n+1][pc+1],Data[n+1][pc+2])
	P[2*n+1] = Point.ByCoordinates(Data[n+1][pc+3],Data[n+1][pc+4],Data[n+1][pc+5])

Lines = []

for n in range(pNum-1):
    Lines += [Line.ByStartPointEndPoint(P[2*n], P[2*n+1])]

OUT = Lines

  
# ----------------------------------------
code_block_3 = CodeBlock(Data4=importExcel)
# ---------- code_block_3.designscript (8 lines) ----------
Data5=List.Transpose(Data4);
List.RestOfItems(Data5[0]);
List.RestOfItems(Data5[1]);
List.RestOfItems(Data5[2]);
List.RestOfItems(Data5[3]);
List.RestOfItems(Data5[4]);
List.RestOfItems(Data5[5]);
List.RestOfItems(Data5[6]);
# ----------------------------------------
level_from_name = Python(IN[0]=code_block_3.out2)
# ---------- level_from_name.python (26 lines) ----------
import clr
clr.AddReference('RevitAPI')
clr.AddReference('RevitServices')

from Autodesk.Revit.DB import FilteredElementCollector, BuiltInCategory, ElementId
from RevitServices.Persistence import DocumentManager

def GetLevel(level_name):
	level_id = None
	level_el = None

	for level in levels:
		if level.Name == level_name:
			level_el = level
			break	
	return level_el

# Get the current Revit document
doc = DocumentManager.Instance.CurrentDBDocument
levels = FilteredElementCollector(doc).OfCategory(BuiltInCategory.OST_Levels).WhereElementIsNotElementType().ToElements()

level_elems = []
level_names = IN[0]
for level_name in level_names:
	level_elems.append(GetLevel(level_name))
OUT = level_elems
# ----------------------------------------
cableTrayByLines = Python(IN[0]=get_lines, IN[1]=code_block_3.out1, IN[2]=level_from_name, IN[3]=code_block_3.out6, IN[4]=code_block_3.out7, IN[5]=code_block_3.out4, IN[6]=code_block_3.out5)
# ---------- cableTrayByLines.python (58 lines) ----------
import clr

clr.AddReference("RevitServices")
import RevitServices
from RevitServices.Persistence import DocumentManager
from RevitServices.Transactions import TransactionManager
doc = DocumentManager.Instance.CurrentDBDocument

clr.AddReference("RevitAPI")
import Autodesk
from Autodesk.Revit.DB import *

clr.AddReference("RevitNodes")
import Revit
clr.ImportExtensions(Revit.Elements)
clr.ImportExtensions(Revit.GeometryConversion)

def SetParam(name, value):
	parType = tray.LookupParameter(name)
	if parType:
		parType.Set(value)	

toggle = ""

lines = IN[0]
FirstPoint = [x.StartPoint for x in lines]
SecondPoint = [x.EndPoint for x in lines]
cabletraytypesid = IN[1]
levels = UnwrapElement(IN[2])
width = IN[3]
height =IN[4]
mark =IN[5]
service =IN[6]

elements = []
trays =[]

TransactionManager.Instance.EnsureInTransaction(doc)

for i,x in enumerate(FirstPoint):
	tray = Autodesk.Revit.DB.Electrical.CableTray.Create(doc,ElementId(cabletraytypesid[i]),FirstPoint[i].ToXyz(),SecondPoint[i].ToXyz(),levels[i].Id)
	
	param = tray.get_Parameter(BuiltInParameter.RBS_CABLETRAY_WIDTH_PARAM)
	param.SetValueString(width[i].ToString())
	
	param2 = tray.get_Parameter(BuiltInParameter.RBS_CABLETRAY_HEIGHT_PARAM)
	param2.SetValueString(height[i].ToString())

	SetParam("Mark",mark[i])
	SetParam("Service Type", service[i])

	#trays.append(tray)
	elements.append(tray.ToDSType(False))

TransactionManager.Instance.TransactionTaskDone()
	
	
OUT = elements
# ----------------------------------------
code_block_4 = CodeBlock(Elem1=cableTrayByLines) { Elem1.Id; }
locationCurve = Elements.Element.LocationCurve(element=cableTrayByLines)
code_block_5 = CodeBlock(Id=code_block_4, D=locationCurve) { [Id, D.StartPoint.X,D.StartPoint.Y,D.StartPoint.Z, D.EndPoint.X,D.EndPoint.Y,D.EndPoint.Z]; }
transpose = List.Transpose(lists=code_block_5)
cabletray_fitting = Python(IN[0]=cableTrayByLines, IN[1]=code_block_3.out3, IN[2]=code_block_5)
# ---------- cabletray_fitting.python (67 lines) ----------
import clr

clr.AddReference("RevitServices")
import RevitServices
from RevitServices.Persistence import DocumentManager
from RevitServices.Transactions import TransactionManager
doc = DocumentManager.Instance.CurrentDBDocument

clr.AddReference("RevitAPI")
from Autodesk.Revit.DB import *

clr.AddReference("RevitNodes")
import Revit
clr.ImportExtensions(Revit.Elements)
clr.ImportExtensions(Revit.GeometryConversion)

def closest_connectors(pipe1, pipe2):
	conn1 = pipe1.ConnectorManager.Connectors
	conn2 = pipe2.ConnectorManager.Connectors

	dist = 100000000
	connset = None
	for c in conn1:
		for d in conn2:
			conndist = c.Origin.DistanceTo(d.Origin)
			if conndist < dist:
				dist = conndist
				connset = [c,d]
	return connset

def check_dir(conn1,conn2):
	if conn1.CoordinateSystem.BasisZ.ToString() == conn2.CoordinateSystem.BasisZ.ToString() or conn1.CoordinateSystem.BasisZ.ToString() == (conn2.CoordinateSystem.BasisZ*-1).ToString():
		return True
	else:
		return False

def drawFitting(pipe1,pipe2):

	TransactionManager.Instance.EnsureInTransaction(doc)

	for p1,p2 in zip(pipe1,pipe2):
		connectors = closest_connectors(p1,p2)
		
	try:
		if check_dir(connectors[0],connectors[1]):
			fitting = doc.Create.NewUnionFitting(connectors[0],connectors[1])
		else:
			fitting = doc.Create.NewElbowFitting(connectors[0],connectors[1])
	except:
		print("Fitting Error")	
			
	else:
		if fitting is not None:
			fittings.append(fitting.ToDSType(False))
		
	TransactionManager.Instance.TransactionTaskDone()


Data = IN[0]
Selection = IN[1]
fittings = []

for n in range(len(Data)-1):
	if Selection[n]:
		drawFitting([UnwrapElement(Data[n])], [UnwrapElement(Data[n+1])])

OUT = fittings
# ----------------------------------------
code_block_6 = CodeBlock(E=cabletray_fitting) { [E.Id, E.Location.X,E.Location.Y,E.Location.Z]; }
transpose_2 = List.Transpose(lists=code_block_6)
join = List.Join(list0=transpose, list1=transpose_2)
exportExcel = Data.ExportExcel(filePath=code_block.out0, sheetName=code_block.out1, startRow=code_block.out2, startCol=code_block.out3, data=join, overWrite=code_block.out4)
code_block_7 = CodeBlock(SEQ01=exportExcel) { [["ID","X1","Y1","Z1","X2","Y2","Z2"]]; 0; SEQ01; }
exportExcel_2 = Data.ExportExcel(filePath=code_block.out0, sheetName=code_block.out1, startRow=code_block_7.out1, startCol=code_block.out3, data=code_block_7.out0, overWrite=code_block_7.out1)
