# Dynamo graph DrawTrays29.dyn (Dynamo 2.3.0.5885)
# packages: Universo_BIM 19.10.11

code_block = CodeBlock { "C:\\Revit\\Excel\\RevitMacros02.xlsx"; "LineDataOut"; 1; 1; 1; }
code_block_2 = CodeBlock { [["Id","Mark","X1","Y1","Z1","X2","Y2","Z2"]]; ["Tray Without Fittings"]; ["Tray With Fittings"]; ["Fittings"]; }
code_block_3 = CodeBlock { "C:\\Revit\\Excel\\RevitMacros02.xlsx"; "LineDataIn"; false; true; }
file_from_path = FileObject(path=code_block_3.out0)
importExcel = Data.ImportExcel(file=file_from_path, sheetName=code_block_3.out1, readAsStrings=code_block_3.out2, showExcel=code_block_3.out3)
get_lines = Python(IN[0]=importExcel)
# ---------- get_lines.python (25 lines) ----------
import sys
import clr

clr.AddReference('ProtoGeometry')
from Autodesk.DesignScript.Geometry import *

Data = IN[0]
pNum = len(Data)

pc = 7 #Colum for point data begin

P = [0]*pNum*2

for n in range(pNum-1):
	P[2*n] = Point.ByCoordinates(Data[n+1][pc],Data[n+1][pc+1],Data[n+1][pc+2])
	P[2*n+1] = Point.ByCoordinates(Data[n+1][pc+3],Data[n+1][pc+4],Data[n+1][pc+5])

Lines = []

for n in range(pNum-1):
    Lines += [Line.ByStartPointEndPoint(P[2*n], P[2*n+1])]

OUT = Lines

  
# ----------------------------------------
code_block_4 = CodeBlock(Data4=importExcel)
# ---------- code_block_4.designscript (8 lines) ----------
Data5=List.Transpose(Data4);
List.RestOfItems(Data5[0]);
List.RestOfItems(Data5[1]);
List.RestOfItems(Data5[2]);
List.RestOfItems(Data5[3]);
List.RestOfItems(Data5[4]);
List.RestOfItems(Data5[5]);
List.RestOfItems(Data5[6]);
# ----------------------------------------
level_from_name = Python(IN[0]=code_block_4.out2)
# ---------- level_from_name.python (26 lines) ----------
import clr
clr.AddReference('RevitAPI')
clr.AddReference('RevitServices')

from Autodesk.Revit.DB import FilteredElementCollector, BuiltInCategory, ElementId
from RevitServices.Persistence import DocumentManager

def GetLevel(level_name):
	level_id = None
	level_el = None

	for level in levels:
		if level.Name == level_name:
			level_el = level
			break	
	return level_el

# Get the current Revit document
doc = DocumentManager.Instance.CurrentDBDocument
levels = FilteredElementCollector(doc).OfCategory(BuiltInCategory.OST_Levels).WhereElementIsNotElementType().ToElements()

level_elems = []
level_names = IN[0]
for level_name in level_names:
	level_elems.append(GetLevel(level_name))
OUT = level_elems
# ----------------------------------------
cableTrayByLines = Python(IN[0]=get_lines, IN[1]=code_block_4.out1, IN[2]=level_from_name, IN[3]=code_block_4.out6, IN[4]=code_block_4.out7, IN[5]=code_block_4.out4, IN[6]=code_block_4.out5)
# ---------- cableTrayByLines.python (58 lines) ----------
import clr

clr.AddReference("RevitServices")
import RevitServices
from RevitServices.Persistence import DocumentManager
from RevitServices.Transactions import TransactionManager
doc = DocumentManager.Instance.CurrentDBDocument

clr.AddReference("RevitAPI")
import Autodesk
from Autodesk.Revit.DB import *

clr.AddReference("RevitNodes")
import Revit
clr.ImportExtensions(Revit.Elements)
clr.ImportExtensions(Revit.GeometryConversion)

def SetParam(name, value):
	parType = tray.LookupParameter(name)
	if parType:
		parType.Set(value)	

toggle = ""

lines = IN[0]
FirstPoint = [x.StartPoint for x in lines]
SecondPoint = [x.EndPoint for x in lines]
cabletraytypesid = IN[1]
levels = UnwrapElement(IN[2])
width = IN[3]
height =IN[4]
mark =IN[5]
service =IN[6]

elements = []
trays =[]

TransactionManager.Instance.EnsureInTransaction(doc)

for i,x in enumerate(FirstPoint):
	tray = Autodesk.Revit.DB.Electrical.CableTray.Create(doc,ElementId(cabletraytypesid[i]),FirstPoint[i].ToXyz(),SecondPoint[i].ToXyz(),levels[i].Id)
	
	param = tray.get_Parameter(BuiltInParameter.RBS_CABLETRAY_WIDTH_PARAM)
	param.SetValueString(width[i].ToString())
	
	param2 = tray.get_Parameter(BuiltInParameter.RBS_CABLETRAY_HEIGHT_PARAM)
	param2.SetValueString(height[i].ToString())

	SetParam("Mark",mark[i])
	SetParam("Service Type", service[i])

	#trays.append(tray)
	elements.append(tray.ToDSType(False))

TransactionManager.Instance.TransactionTaskDone()
	
	
OUT = elements
# ----------------------------------------
code_block_5 = CodeBlock(Elem1=cableTrayByLines) { Elem1.Id; }
tray_mark = Python(IN[0]=cableTrayByLines)
# ---------- tray_mark.python (24 lines) ----------
import clr
clr.AddReference('RevitAPI')
clr.AddReference('RevitServices')

from Autodesk.Revit.DB import *
from RevitServices.Persistence import DocumentManager

# Function to get the coordinates of connection points

def getMark(tray):
	mark_param = tray.LookupParameter("Mark")
	return(mark_param.AsString())

f = 25.4*12

trays = IN[0]

params = []

for tray1 in trays:
	tray = UnwrapElement(tray1)
	params.append(getMark(tray))

OUT = params
# ----------------------------------------
watch = Watch(tray_mark)
locationCurve = Elements.Element.LocationCurve(element=cableTrayByLines)
code_block_6 = CodeBlock(Id=code_block_5, Mark=watch, D=locationCurve) { [Id,Mark,D.StartPoint.X,D.StartPoint.Y,D.StartPoint.Z, D.EndPoint.X,D.EndPoint.Y,D.EndPoint.Z]; }
transpose = List.Transpose(lists=code_block_6)
cabletray_fitting = Python(IN[0]=cableTrayByLines, IN[1]=code_block_4.out3, IN[2]=code_block_6)
# ---------- cabletray_fitting.python (93 lines) ----------
import clr
clr.AddReference('RevitAPI')
clr.AddReference("RevitServices")
import RevitServices
from RevitServices.Persistence import DocumentManager
from RevitServices.Transactions import TransactionManager
doc = DocumentManager.Instance.CurrentDBDocument

from Autodesk.Revit.DB import *

clr.AddReference("RevitNodes")
import Revit

clr.ImportExtensions(Revit.Elements)
clr.ImportExtensions(Revit.GeometryConversion)


def createText(text):
	text_location = XYZ(0, 0, 0)
	active_view = doc.ActiveView
	text_note_types = FilteredElementCollector(doc).OfClass(TextNoteType).ToElements()
	text_type = text_note_types[0]
	text_note = TextNote.Create(doc, active_view.Id, text_location, text, text_type.Id) 
	return(text_note.Id)

def log(text):
	with open("C:\\Revit\\Dynamos\\log.txt", "a") as file:
		file.write(text+"\n")	

def getMark(tray):
	mark_param = tray.LookupParameter("Mark")
	return(mark_param.AsString())

def setMark(tray, value1):
	mark_param = tray.LookupParameter("Mark")
	mark_param.Set(value1)

def setFittingMark(tray1,tray2,fitting):
	mark1 = getMark(tray1)
	mark2 = getMark(tray2)
	setMark(fitting,mark1+"-"+mark2)

def closest_connectors(pipe1, pipe2):
	conn1 = pipe1.ConnectorManager.Connectors
	conn2 = pipe2.ConnectorManager.Connectors

	dist = 100000000
	connset = None
	for c in conn1:
		for d in conn2:
			conndist = c.Origin.DistanceTo(d.Origin)
			if conndist < dist:
				dist = conndist
				connset = [c,d]
	return connset

def check_dir(conn1,conn2):
	if conn1.CoordinateSystem.BasisZ.ToString() == conn2.CoordinateSystem.BasisZ.ToString() or conn1.CoordinateSystem.BasisZ.ToString() == (conn2.CoordinateSystem.BasisZ*-1).ToString():
		return True
	else:
		return False

def drawFitting(pipe1,pipe2):

	TransactionManager.Instance.EnsureInTransaction(doc)
	connectors = closest_connectors(pipe1,pipe2)
	
	try:
		if check_dir(connectors[0],connectors[1]):
			textId = 100
			#fitting = doc.Create.NewUnionFitting(connectors[0],connectors[1])
			fitting = doc.Create.NewTransitionFitting(connectors[0],connectors[1])
		else:
			fitting = doc.Create.NewElbowFitting(connectors[0],connectors[1])
	except:
		return		
	
	if fitting is not None:
		setFittingMark(pipe1,pipe2,fitting)
		fittings.append(fitting.ToDSType(False))

	TransactionManager.Instance.TransactionTaskDone()


Data = IN[0]
Selection = IN[1]
fittings = []

for n in range(len(Data)-1):
	if Selection[n]:
		drawFitting(UnwrapElement(Data[n]), UnwrapElement(Data[n+1]))

OUT = fittings
# ----------------------------------------
getElementFromId = Python(IN[0]=code_block_5, IN[1]=cabletray_fitting)
# ---------- getElementFromId.python (27 lines) ----------
import clr

# Import RevitAPI classes
clr.AddReference('RevitAPI')
clr.AddReference('RevitServices')
from Autodesk.Revit.DB import ElementId
from RevitServices.Persistence import DocumentManager

# Inputs
element_ids = IN[0]  # List of element IDs
doc = DocumentManager.Instance.CurrentDBDocument

# Initialize an empty list to store elements
elements = []

# Iterate through the list of IDs
for eid in element_ids:
    # Convert the input ID to an ElementId object
    id = ElementId(eid)
    # Get the element
    element = doc.GetElement(id)
    # Add the element to the list
    if element:
        elements.append(element)

# Output the list of elements
OUT = elements
# ----------------------------------------
locationCurve_2 = Elements.Element.LocationCurve(element=getElementFromId)
code_block_7 = CodeBlock(Id=code_block_5, Mark=watch, D=locationCurve_2) { [Id,Mark,D.StartPoint.X,D.StartPoint.Y,D.StartPoint.Z, D.EndPoint.X,D.EndPoint.Y,D.EndPoint.Z]; }
transpose_2 = List.Transpose(lists=code_block_7)
tray_params = Python(IN[0]=cabletray_fitting)
# ---------- tray_params.python (39 lines) ----------
import clr
clr.AddReference('RevitAPI')
clr.AddReference('RevitServices')

from Autodesk.Revit.DB import *
from RevitServices.Persistence import DocumentManager

# Function to get the coordinates of connection points

def get_cable_tray_params(cable_tray):
	params = {}
	for param in cable_tray.Parameters:
		param_name = param.Definition.Name
		if param.StorageType == StorageType.String:
			param_value = param.AsString()
		elif param.StorageType == StorageType.Double:
			param_value = param.AsDouble()
		elif param.StorageType == StorageType.Integer:
			param_value = param.AsInteger()
		elif param.StorageType == StorageType.ElementId:
			param_value = param.AsElementId().IntegerValue
		else:
			param_value = None
		params[param_name] = param_value
	return params

f = 25.4*12

trays = IN[0]

all_params = []
#all_params = [['Id', 'Mark','Service Type', 'TypeId', 'TypeName', 'FamilyName', 'Length', 'Width', 'Height','X1','Y1','Z1','X2','Y2','Z2','X3','Y3','Z3','X4','Y4','Z4']]

for tray in trays:
	params = get_cable_tray_params(UnwrapElement(tray))
	param = params['Mark']
	all_params.extend([param])

OUT = all_params
# ----------------------------------------
code_block_8 = CodeBlock(E=cabletray_fitting, Mark=tray_params) { [E.Id,Mark,E.Location.X,E.Location.Y,E.Location.Z]; }
transpose_3 = List.Transpose(lists=code_block_8)
join = List.Join(list0=code_block_2.out0, list1=code_block_2.out1, list2=transpose, list3=code_block_2.out2, list4=transpose_2, list5=code_block_2.out3, list6=transpose_3)
exportExcel = Data.ExportExcel(filePath=code_block.out0, sheetName=code_block.out1, startRow=code_block.out2, startCol=code_block.out3, data=join, overWrite=code_block.out4)
watch_2 = Watch(cabletray_fitting)
