# Dynamo graph GetCadData09.dyn (Dynamo 2.3.0.5885)

code_block = CodeBlock { "C:\\Revit\\Excel\\RevitMacros02.xlsx"; "TypeData"; 0; 1; "Levels"; }
number_slider = DoubleSlider(37.8, range=0..100 step 0.1)
python_script = Python(IN[0]=number_slider)
# ---------- python_script.python (13 lines) ----------
import clr
clr.AddReference('RevitAPI')
clr.AddReference('RevitServices')
from RevitServices.Persistence import DocumentManager
from Autodesk.Revit.DB import FilteredElementCollector, BuiltInCategory, ElementType

# Get the active document
doc = DocumentManager.Instance.CurrentDBDocument

tray_types = FilteredElementCollector(doc).OfClass(ElementType).OfCategory(BuiltInCategory.OST_CableTray).ToElements()

# Output the cable tray types
OUT = tray_types
# ----------------------------------------
watch = Watch(python_script)
watch_2 = Watch(watch)
parameters_to_fetch = CodeBlock { ["Acabado","Category","Family Name","Type Name"]; }
get_parameters = Python(IN[0]=watch_2, IN[1]=parameters_to_fetch)
# ---------- get_parameters.python (32 lines) ----------
# Load the Python Standard and DesignScript Libraries
import sys
import clr
clr.AddReference('ProtoGeometry')
from Autodesk.DesignScript.Geometry import *

parNames = IN[1]
#parNames = ['Acabado','Category','Family Name']
parLen = len(parNames)
parValues = ['']*parLen

list1 = IN[0]

result =[['Id'] + parNames]


for list2 in list1:
	for parVal in parValues:
		parVal = ''
	for item in list2.Parameters:
		itemText = str(item)
		parName = itemText.split(':')[0].strip()
		for n in range(parLen):
			if parName == parNames[n]:
				parValues[n] =itemText.split(':')[1].strip();
	
	parRow = [list2.Id]
	for n in range(parLen):
		parRow.append(parValues[n])
	result.append(parRow)

OUT = result
# ----------------------------------------
watch_3 = Watch(get_parameters)
exportExcel = Data.ExportExcel(filePath=code_block.out0, sheetName=code_block.out1, startRow=code_block.out2, startCol=code_block.out3, data=watch_3, overWrite=code_block.out3)
indexOf = List.IndexOf(list=watch, element=watch)
watch_4 = Watch(indexOf)
code_block_2 = CodeBlock {  }
get_levels = Python()
# ---------- get_levels.python (19 lines) ----------
import clr
clr.AddReference('RevitAPI')
clr.AddReference('RevitServices')

from Autodesk.Revit.DB import FilteredElementCollector, BuiltInCategory, Level
from RevitServices.Persistence import DocumentManager

# Get the current Revit document
doc = DocumentManager.Instance.CurrentDBDocument

# Collect all levels in the document
levels = FilteredElementCollector(doc).OfCategory(BuiltInCategory.OST_Levels).WhereElementIsNotElementType().ToElements()

level_header = [["Level Name","Elevation"]]
# Get the names and heights of all levels
level_info =[(level.Name, level.Elevation*12*25.4) for level in levels]

# Output the level names and heights
OUT = level_header + level_info
# ----------------------------------------
watch_5 = Watch(get_levels)
exportExcel_2 = Data.ExportExcel(filePath=code_block.out0, sheetName=code_block.out4, startRow=code_block.out2, startCol=code_block.out3, data=watch_5, overWrite=code_block.out3)
code_block_3 = CodeBlock(Data6=watch, index=indexOf) { Data6.Parameters[index][4]; }
watch_6 = Watch(code_block_3)
