# Dynamo graph GetCadData13.dyn (Dynamo 3.3.0.6316)

getExcelFiles = Custom[GetExcelFiles]()
code_block = CodeBlock { "C:\\Revit\\Excel\\RevitMacros02.xlsx"; "Document Data"; 0; 1; }
number_slider = DoubleSlider(46.1, range=0..100 step 0.1)
python_script = Python(IN[0]=number_slider)  # IronPython2
# ---------- python_script.python (13 lines) ----------
import clr
clr.AddReference('RevitAPI')
clr.AddReference('RevitServices')
from RevitServices.Persistence import DocumentManager
from Autodesk.Revit.DB import FilteredElementCollector, BuiltInCategory, ElementType

# Get the active document
doc = DocumentManager.Instance.CurrentDBDocument

tray_types = FilteredElementCollector(doc).OfClass(ElementType).OfCategory(BuiltInCategory.OST_CableTray).ToElements()

# Output the cable tray types
OUT = tray_types
# ----------------------------------------
watch = Watch(python_script)
parameters_to_fetch = CodeBlock { ["Category","Family Name","Type Name"]; ["Categoría","Nombre de familia","Nombre de tipo"]; }
get_parameters = Python(IN[0]=watch, IN[1]=parameters_to_fetch.out0)  # IronPython2
# ---------- get_parameters.python (26 lines) ----------
# Load the Python Standard and DesignScript Libraries
import sys
import clr
clr.AddReference('ProtoGeometry')
from Autodesk.DesignScript.Geometry import *

elements = IN[0]
parNames = IN[1]
parLen = len(parNames)

result =[['Id'] + parNames]

for elem in elements:
	parValues = ['']*parLen
	for param in elem.Parameters:
		for n in range(parLen):
			if param.Name == parNames[n]:
				parValues[n] = param.Value
				break
	
	parRow = [elem.Id]
	for par in parValues:
		parRow.append(par)
	result.append(parRow)

OUT = result
# ----------------------------------------
code_block_2 = CodeBlock { [[""],[""]]; }
get_levels = Python()  # IronPython2
# ---------- get_levels.python (22 lines) ----------
import clr
clr.AddReference('RevitAPI')
clr.AddReference('RevitServices')

from Autodesk.Revit.DB import FilteredElementCollector, BuiltInCategory, Level
from RevitServices.Persistence import DocumentManager

def dim(val1):
    return round(val1*12*25.4,3)

# Get the current Revit document
doc = DocumentManager.Instance.CurrentDBDocument

# Collect all levels in the document
levels = FilteredElementCollector(doc).OfCategory(BuiltInCategory.OST_Levels).WhereElementIsNotElementType().ToElements()

level_header = [["Level Name","Elevation"]]
# Get the names and heights of all levels
level_info =[(level.Name, dim(level.Elevation)) for level in levels]

# Output the level names and heights
OUT = level_header + level_info
# ----------------------------------------
join = List.Join(list0=get_parameters, list1=code_block_2, list2=get_levels)
exportToExcel = Data.ExportToExcel(filePath=getExcelFiles, sheetName=code_block.out1, startRow=code_block.out2, startColumn=code_block.out2, data=join, overWrite=code_block.out3, writeAsString=code_block.out2)
