# Dynamo custom node GetExcelFile.dyf "GetExcelFiles" (Dynamo 3.3.0.6316)
# category: ELimar

code_block = CodeBlock { "C:\\revit\\excel"; "RevitMacros??"; }
get_excel_file_name = Python(IN[0]=code_block.out0, IN[1]=code_block.out1)  # IronPython2
# ---------- get_excel_file_name.python (17 lines) ----------
import clr
clr.AddReference("System")
from System.IO import Directory

directory = IN[0]
mask = IN[1]
files = Directory.GetFiles(directory, mask + ".xlsx")

#look for macro file
if len(files) == 0:
	files = Directory.GetFiles(directory, mask + ".xlsm")

#Get the last file in the list
if len(files) > 1:
	OUT = files[-1]
else:
    OUT = files[0]
# ----------------------------------------
ExcelFilePath = Output(get_excel_file_name)
