# Dynamo graph IdentityData4.dyn (Dynamo 3.3.0.6316)

getExcelFiles = Custom[GetExcelFiles]()
file_from_path = FileObject(path=getExcelFiles)
code_block = CodeBlock { "C:\\Revit\\Excel\\RevitMacros02.xlsx"; "IdentityData"; false; true; }
importExcel = Data.ImportExcel(file=file_from_path, sheetName=code_block.out1, readAsStrings=code_block.out2, showExcel=code_block.out3)
watch = Watch(importExcel)
python_script = Python(IN[0]=importExcel)  # IronPython2
# ---------- python_script.python (55 lines) ----------
import clr
clr.AddReference('RevitAPI')
clr.AddReference('RevitServices')

from Autodesk.Revit.DB import *
from RevitServices.Persistence import DocumentManager
from RevitServices.Transactions import TransactionManager
doc = DocumentManager.Instance.CurrentDBDocument

def get_cable_tray_params(cable_tray):
    params = {}
    for param in cable_tray.Parameters:
        param_name = param.Definition.Name
        if param.StorageType == StorageType.String:
            param_value = param.AsString()
        elif param.StorageType == StorageType.Double:
            param_value = param.AsDouble()
        elif param.StorageType == StorageType.Integer:
            param_value = param.AsInteger()
        elif param.StorageType == StorageType.ElementId:
            param_value = param.AsElementId().IntegerValue
        else:
            param_value = None
        params[param_name] = param_value
    return params


outdata = []

datas = IN[0]

header =datas[0]
paramName = header[1]

TransactionManager.Instance.EnsureInTransaction(doc)

for data in datas[1:]:
    elemId = ElementId(data[0])
    newVal = str(data[1])
    elem = doc.GetElement(elemId)
    if elem is not None:
        param = elem.LookupParameter(paramName)
        param.Set(newVal)
    

TransactionManager.Instance.TransactionTaskDone()    
    
for data in datas[1:]:
    elemId = ElementId(data[0])
    elem = doc.GetElement(elemId)
    if elem is not None:
        params = get_cable_tray_params(elem)
        outdata.append(params[paramName])
    
OUT = outdata
# ----------------------------------------
watch_2 = Watch(python_script)
